# Grasshopper definition grasshopper-boomerang.gh (Grasshopper 1.0.7)

trailing_edge = Slider(1, range=-1.001..5)
fillet = Slider(4, range=-1.001..5)
thickness = Slider(3.5, range=1..5)
# Input the two curves and some numeric parameters for the thickness and leading edge roundover.
main_outline = Curve(<curve referenced from the Rhino model>)
top_outline = Curve(<curve referenced from the Rhino model>)
unit_z = UnitZ(Factor=thickness)
unit_z_2 = UnitZ(Factor=trailing_edge)
loft_options = LoftOptions(Closed=False, Adjust=False, Rebuild=100, Refit=100, Type=3)
# Grab the two outlines and move the main outline up slightly, and the top outline to the full thickness.
move = Move(Geometry=main_outline, Motion=unit_z_2)  # -> Geometry, Transform
move_2 = Move(Geometry=top_outline, Motion=unit_z)  # -> Geometry, Transform
# Loft over the three curves and cap the ends. This completes the main boomerang shape.
loft = Loft(Curves=[main_outline, move.Geometry, move_2.Geometry], Options=loft_options)
cap_holes_ex = CapHolesEx(Brep=loft)  # -> Brep, Caps, Solid
deconstruct_brep = DeconstructBrep(Brep=cap_holes_ex.Brep)  # -> Faces, Edges, Vertices
unit_z_3 = UnitZ(Factor=1)
evaluate_surface = EvaluateSurface(Surface=deconstruct_brep.Faces, Point=Point(0, -5, 0))  # -> Point, Normal, UDirection, VDirection, Frame
# Figure out which is the top face by comparing its normal to Unit Z. Isolate the edge around the top face.
dot_product = DotProduct(VectorA=evaluate_surface.Normal, VectorB=unit_z_3, Unitize=False)
similarity = Similarity(FirstNumber=dot_product, SecondNumber=1, Threshold=0.1)  # -> Similarity, AbsoluteDifference
cull_pattern = CullPattern(List=evaluate_surface.Point, CullPattern=similarity.Similarity)
edges_from_faces = EdgesFromFaces(Brep=cap_holes_ex.Brep, Points=cull_pattern)  # -> Edges, Indices
# Fillet the top edge by the desired amount.
boomerang = FilletEdge(Shape=cap_holes_ex.Brep, Blend=0, Metric=0, Edges=edges_from_faces.Indices, Radii=fillet)
